# Grasshopper definition SpacePartition.gh (Grasshopper 1.0.7)
# plug-ins: FloorsAndVolumes, Human, PTComponentLibrary, SpaceSyntaxDesign_GH

# ---- group: Labels
text = Text(Tree({0;0}: ["Unidades sanitarias mujeres / privadas"], {0;1}: ["Unidades sanitarias hombres / privadas"], {0;2}: ["Cuarto de aseo "], {0;3}: ["Área de aseo de residuos"], {0;4}: ["Almacen General Insumos de Aseo "], {0;5}: ["Área de UPC-Rack"]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))

# ---- group: Areas
text_2 = Text(Tree({0;0}: ["3"], {0;1}: ["3"], {0;2}: ["6"], {0;3}: ["1"], {0;4}: ["5"], {0;5}: ["4"]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))

# ---- group: Topology
integer = Integer(Tree({0}: [7], {1}: [7], {2}: [3], {3}: [2, 11], {4}: [16, 21, 19], {5}: [19]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))

# ---- group: ID
text_3 = Text(Tree({0;0}: ["5"], {0;1}: ["5"], {0;2}: ["5"], {0;3}: ["5"], {0;4}: ["5"], {0;5}: ["5"]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))

# ----
number_slider = Slider(4, range=0..10)
path_mapper = PathMapper(text, source="{A;B}", target="{A}")
path_mapper_2 = PathMapper(text_2, source="{A;B}", target="{A}")
path_mapper_3 = PathMapper(integer, source="{A;B}", target="{A}")
path_mapper_4 = PathMapper(text_3, source="{A;B}", target="{A}")

# ---- group: Grid / Controllers
number_slider_2 = Slider(21, range=0..21)
number_slider_3 = Slider(5, range=0..5)
division = Division(A=number_slider_2, B=Slider(4, range=0..10))
division_2 = Division(A=number_slider_3, B=Slider(2, range=0..10))
number_slider_4 = Slider(0, range=0..1)  # disabled

# ----
prunebranches = CSharpScript(branches=path_mapper, howMany=number_slider)  # -> prunedTree, branchCounter; inputs branches: tree of String, howMany: Int32
# ---------- prunebranches: C# ----------
    var treeOut = new DataTree<string>();

    for( int i = 0; i < branches.BranchCount - howMany; ++i )
      treeOut.AddRange(branches.Branch(i), new GH_Path(i));

    prunedTree = treeOut;
    branchCounter = treeOut.BranchCount;
# ---------- end prunebranches ----------
prunebranches_2 = CSharpScript(branches=path_mapper_2, howMany=number_slider)  # -> prunedTree, branchCounter; inputs branches: tree of String, howMany: Int32; same code as prunebranches
mass_addition = MassAddition(Input=prunebranches_2.prunedTree)  # -> Result, PartialResults
number_slider_5 = Slider(4, range=0..10)
flatten_tree = FlattenTree(Tree=prunebranches_2.prunedTree, Path="{0}")
number_slider_6 = Slider(0.1, range=0..0.1)
list_length = ListLength(List=flatten_tree)
integer_2 = Integer(list_length)
subtraction = Subtraction(A=Slider(1, range=0..1), B=number_slider_6)

# ---- group: Voronoi / Controllers
seedsx = GenePool(
    Decimals=2,
    Maximum=0.9,
    Minimum=0.1,
    Value=[0.7916902884, 0.1856309824, 0.8240759313, 0.7814801022, 0.8948051214, 0.7561955336, 0.327813466, 0.1016694851, 0.15, 0.3537610461])
seedsy = GenePool(
    Decimals=2,
    Maximum=0.9,
    Minimum=0.1,
    Value=[0.6396212957, 0.361316763, 0.4715899756, 0.7953152224, 0.8171917945, 0.2310957857, 0.6162591847, 0.3390167115, 0.6341980829, 0.37])

# ----
number = Number(prunebranches_2.prunedTree)
number_slider_7 = Slider(3047, range=0..10000)
curve = Curve()  # disabled
surface = Surface(curve)  # disabled
number_slider_8 = Slider(0, range=0..50)
curve_2 = Curve(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)
multiplication = Multiplication(A=number, B=Slider(0.2, range=0..1))
multiplication_2 = Multiplication(A=number, B=0.3)
addition = Addition(A=number, B=multiplication_2)  # -> simplify(Result)
addition_2 = Addition(A=addition, B=multiplication)  # -> simplify(Result)
panel = Panel(addition_2)
subtraction_2 = Subtraction(A=addition, B=multiplication)  # -> simplify(Result)
mass_addition_2 = MassAddition(Input=flatten(addition))  # -> Result, PartialResults
panel_2 = Panel("""0: Privado
1: Privado
2: Público
3: SemiPrivado""")
curve_3 = Curve([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])
text_4 = Text(prunebranches.prunedTree)
graft_tree = GraftTree(Tree=panel_2, IncludeEmptyLists=True, IncludeNullItems=True)  # -> simplify(Tree)
graft_tree_2 = GraftTree(Tree=text_4, IncludeEmptyLists=True, IncludeNullItems=True)
addindextolabels = CSharpScript(labels=graft_tree_2)  # -> indexedLabels; inputs labels: tree of String
# ---------- addindextolabels: C# ----------
    var newLabels = new DataTree<string>();
    
    for( int i = 0; i < labels.BranchCount; ++i )
      for( int j = 0; j < labels.Branch(i).Count; ++j )
      {
      
        newLabels.Add( i.ToString() + " " + labels.Branch(i)[j], new GH_Path(i) );
      
      }
    
    indexedLabels = newLabels;
# ---------- end addindextolabels ----------
galapagos = Galapagos(fitness=mass_addition_3, gene=[seedsx, seedsy])
panel_3 = Panel(addition)

# ---- group: Grid
number_slider_9 = Slider(22, range=0..100)  # disabled
number_slider_10 = Slider(4, range=0..10)  # disabled
number_slider_11 = Slider(0, range=0..100)  # disabled
construct_domain = ConstructDomain(DomainStart=number_slider_11, DomainEnd=number_slider_10)  # disabled
number_slider_12 = Slider(2, range=0..10)  # disabled
genepoolmodifier = GenePoolModifier(GeneList="Weights", Count=expr("x+1", number_slider_9), Domain=construct_domain)  # disabled
number_slider_13 = Slider(17.8173, range=-50..20)  # disabled
knot_vector = KnotVector(Count=expr("x+1", number_slider_9), Degree=number_slider_12, Periodic=False)  # disabled
dom = ConstructDomain(DomainStart=expr("-x", number_slider_2), DomainEnd=number_slider_2)
range = Range(Domain=dom, Steps=number_slider_9)  # disabled
dom_2 = ConstructDomain(DomainStart=expr("-x", number_slider_3), DomainEnd=number_slider_3)
weights = GenePool(Decimals=2, Maximum=4, Minimum=0, Value=[2, 2, 2, 2, 2, 2, 2, 2, 2, 2, 2, 2, 2, 2, 2, 2, 2, 2, 2, 2, 2, 2, 2])  # disabled
unit_x = UnitX(Factor=number_slider_13)  # disabled
point = Point(Point(-27.55069635, 0.2364199029, 0))
number_slider_14 = Slider(1000, range=0..1000)  # disabled
number_slider_15 = Slider(0, range=0..1000)  # disabled
number_slider_16 = Slider(0, range=0..1000)  # disabled
deconstruct_domain = DeconstructDomain(Domain=dom)  # -> Start, End
rectangle = Rectangle(Plane=point, XSize=dom_2, YSize=dom, Radius=0)  # -> Rectangle, Length
unit_y = UnitY(Factor=deconstruct_domain.Start)
colour_rgb = ColourRGB(Alpha=255, Red=number_slider_14, Green=number_slider_15, Blue=number_slider_16)  # disabled
number_slider_17 = Slider(3.01, range=0..10)  # disabled
move = Move(Geometry=point, Motion=unit_y)  # -> Geometry, Transform
crv = Curve(rectangle.Rectangle)
ptsrfdomlen = SurfaceDomainLength(Surface=crv, ULength=division_2, VLength=division)
ptborders = GenerateBorders(Grid=ptsrfdomlen, PanelShape=0)  # -> simplify(Border)
crv_2 = Curve(flatten(ptborders))
area = Area(Geometry=ptborders, UseTasks=False)  # -> Area, Centroid

# ---- group: Grid / Perlin
number_slider_18 = Slider(4, range=0..10)  # disabled
number_slider_19 = Slider(2.2, range=0..10)  # disabled
number_slider_20 = Slider(0.575734, range=0..1)  # disabled
number_slider_21 = Slider(13.910642, range=0..100)  # disabled
number_slider_22 = Slider(27.513073, range=0..100)  # disabled
number_slider_23 = Slider(1000, range=0..1000)  # disabled
perlinnoise = CSharpScript(x=range, fre=number_slider_19, amp=number_slider_20, iter=number_slider_18, t=number_slider_22, seed=number_slider_23)  # -> out, A; inputs x: Double, fre: Double, amp: Double, iter: Int32, t: Double, seed: Int32; disabled
# ---------- perlinnoise: C# ----------
    //time+=1e-7;
    
    A = fbm(new vec3(x, 0, 0) + t, fre, amp, iter, seed);
# ---------- perlinnoise: C# additional code ----------
  //double time = 0;
  
  double hash(double a, int seed)
  {

    //return fract(Math.Sin(a) * 4513.15);
    var rand = new Random( seed );
    return rand.NextDouble() * ( 1.0 + 1.0 ) - 1.0;

  }

  double noise(vec3 x, int seed)
  {

    vec3 p = x.floor();
    vec3 k = x.fract();

    k *= k * k * ( 3.0 - 2.0 * k );

    double n = p.X() + p.Y() * 57.0 + p.Z() * 113.0;

    double a = hash(n, seed);
    double b = hash(n + 1.0, seed);
    double c = hash(n + 57.0, seed);
    double d = hash(n + 58.0, seed);

    double e = hash(n + 113.0, seed);
    double f = hash(n + 114.0, seed);
    double g = hash(n + 170.0, seed);
    double h = hash(n + 171.0, seed);

    double res = vec3.mix(vec3.mix(vec3.mix(a, b, k.X()), vec3.mix(c, d, k.X()), k.Y()),
      vec3.mix(vec3.mix(e, f, k.X()), vec3.mix(g, h, k.X()), k.Y()),
      k.Z()
      );

    return res;

  }

  double fbm(vec3 f, double freq, double ampl, int iter, int seed)
  {

    double amp = 1.0, fre = 1.7, res = 0.0;

    for( int i = 0; i < iter; ++i )
    {

      amp *= ampl;
      fre *= freq;

      amp += amp;

      res += amp * noise(fre * f, seed);

    }

    return res;

  }

  class vec3
  {

    double x, y, z;

    public vec3(double x, double y, double z)
    {

      this.x = x;
      this.y = y;
      this.z = z;

    }

    public vec3(Point3d point)
    {

      this.x = point.X;
      this.y = point.Y;
      this.z = point.Z;

    }

    public double X()
    {

      return x;

    }

    public double Y()
    {

      return y;

    }

    public double Z()
    {

      return z;

    }

    // Addition operator overload.
    public static vec3 operator+( vec3 x, vec3 y )
    {

      return new vec3(x.X() + y.X(), x.Y() + y.Y(), x.Z() + y.Z());

    }

    public static vec3 operator+( vec3 x, double y )
    {

      return new vec3(x.X() + y, x.Y() + y, x.Z() + y);

    }

    public static vec3 operator+( double y, vec3 x )
    {

      return new vec3(y + x.X(), y + x.Y(), y + x.Z());

    }

    // Subtraction operator overload.
    public static vec3 operator-( vec3 x, vec3 y )
    {

      return new vec3(x.X() - y.X(), x.Y() - y.Y(), x.Z() - y.Z());

    }

    public static vec3 operator-( vec3 x, double y )
    {

      return new vec3(x.X() - y, x.Y() - y, x.Z() - y);

    }

    public static vec3 operator-( double y, vec3 x )
    {

      return new vec3(y - x.X(), y - x.Y(), y - x.Z());

    }

    // Multiplication operator overload.
    public static vec3 operator*( vec3 x, vec3 y )
    {

      return new vec3(x.X() * y.X(), x.Y() * y.Y(), x.Z() * y.Z());

    }

    public static vec3 operator*( vec3 x, double y )
    {

      return new vec3(x.X() * y, x.Y() * y, x.Z() * y);

    }

    public static vec3 operator*( double y, vec3 x )
    {

      return new vec3(y * x.X(), y * x.Y(), y * x.Z());

    }

    // Fractional part of a vec3.
    public vec3 fract()
    {

      return new vec3(fract(x), fract(y), fract(y));

    }

    // Floor.
    public vec3 floor()
    {

      return new vec3(Math.Floor(x), Math.Floor(y), Math.Floor(z));

    }

    // Fractional part of a double.
    public double fract(double x)
    {

      return x - Math.Truncate(x);

    }

    // Linear interpolation of a double.
    public static double mix(double a, double b, double c)
    {

      return a - ( 1 - c ) + b * c;

    }

    // Linear interpolation of a vec3.
    public static vec3 mix(vec3 a, vec3 b, double c)
    {

      double mixX = mix(a.X(), b.X(), c);
      double mixY = mix(a.Y(), b.Y(), c);
      double mixZ = mix(a.Z(), b.Y(), c);

      return new vec3(mixX, mixY, mixZ);

    }

    public Point3d toPoint()
    {

      return new Point3d(this.X(), this.Y(), this.Z());

    }

  }

  public double fract(double x)
  {

    return x - Math.Truncate(x);

  }
# ---------- end perlinnoise ----------

# ---- group: Grid (continued)
construct_point = ConstructPoint(XCoordinate=perlinnoise.A, YCoordinate=range, ZCoordinate=0)  # disabled
list_item = ListItem(List=construct_point, Index=0, Wrap=True)  # disabled
vector_2pt = Vector2Pt(PointA=list_item, PointB=move.Geometry, Unitize=False)  # -> Vector, Length; disabled
move_2 = Move(Geometry=construct_point, Motion=vector_2pt.Vector)  # -> Geometry, Transform; disabled
nurbs_curve_pwk = NurbsCurvePWK(Points=move_2.Geometry, Weights=weights, Knots=knot_vector)  # -> Curve, Length, Domain; disabled
custom_preview_lineweights = CustomPreviewLineweights(Geometry=nurbs_curve_pwk.Curve, Shader=colour_rgb, Thickness=number_slider_17, Absolute=False)  # disabled
curve_attraction = CurveAttraction(Grid=ptsrfdomlen, CrvAtts=nurbs_curve_pwk.Curve, Magnitude=number_slider_4)  # -> Grid, Weights; disabled

# ---- group: Voronoi
dom_3 = ConstructDomain(DomainStart=number_slider_6, DomainEnd=subtraction)
genemodifier = GenePoolModifier(GeneList="SeedsX", Count=integer_2, Domain=dom_3)
genemodifier_2 = GenePoolModifier(GeneList="SeedsY", Count=integer_2, Domain=dom_3)
pt = ConstructPoint(XCoordinate=seedsx, YCoordinate=seedsy, ZCoordinate=0)
evalsrf = EvaluateSurface(Surface=reparameterize(crv), Point=pt)  # -> Point, Normal, UDirection, VDirection, Frame
pt_2 = Point(evalsrf.Point)
voronoi = Voronoi(Points=pt_2, Boundary=rectangle.Rectangle, BruteForceOverride=False)

# ---- group: ManhattanVoronoi
number_slider_24 = Slider(10, range=0..10)  # disabled
ghpython_script = GhPythonScript(r=number_slider_24, P=pt_2)  # -> out, PL; inputs P: list of Point3d; disabled
# ---------- ghpython_script: Python ----------
__author__ = "Paula"
__version__ = "2019.04.23"

import rhinoscriptsyntax as rs
from Rhino.Geometry import Point3d as P3
from Rhino.Geometry import Polyline as PLine

def taxicab_midnormal ( Point_1 = P3(0,0,0), Point_2 = P3(0,0,0) , leng = 10000):
    dx = abs(Point_1.X - Point_2.X)
    dy = abs(Point_1.Y - Point_2.Y)
    
    C = P3 ( ( Point_1.X + Point_2.X ) / 2, ( Point_1.Y + Point_2.Y ) / 2, ( Point_1.Z + Point_2.Z ) / 2)
    
    """ MPQN, in which M is on the lengeft(X-) or bottom(Y-) """
    P = P3 (0,0,C.Z)
    Q = P3 (0,0,C.Z)
    M = P3 (0,0,C.Z)
    N = P3 (0,0,C.Z)
    
    if dx > dy:
        P.Y = C.Y + dy / 2
        Q.Y = C.Y - dy / 2
        M.Y = P.Y + leng
        N.Y = Q.Y - leng
        if bool(Point_1.Y > Point_2.Y) ^ bool(Point_1.X > Point_2.X):
            P.X = C.X + dy / 2
            Q.X = C.X - dy / 2
        else:
            P.X = C.X - dy / 2
            Q.X = C.X + dy / 2
        M.X = P.X
        N.X = Q.X
    else:
        if dx < dy:
            P.X = C.X + dx / 2
            Q.X = C.X - dx / 2
            M.X = P.X + leng
            N.X = Q.X - leng
            if bool(Point_1.Y > Point_2.Y) ^ bool(Point_1.X > Point_2.X):
                P.Y = C.Y + dx / 2
                Q.Y = C.Y - dx / 2
            else:
                P.Y = C.Y - dx / 2
                Q.Y = C.Y + dx / 2
            M.Y = P.Y
            N.Y = Q.Y
        else:
            if bool(Point_1.Y > Point_2.Y) ^ bool(Point_1.X > Point_2.X):
                P.Y = C.Y - dx / 2
                Q.Y = C.Y + dx / 2
                P.X = C.X - dy / 2
                Q.X = C.X + dy / 2
                M.Y = P.Y - leng
                M.X = P.X - leng
                N.Y = Q.Y + leng
                N.X = Q.X + leng
            else:
                P.Y = C.Y - dx / 2
                Q.Y = C.Y + dx / 2
                P.X = C.X + dy / 2
                Q.X = C.X - dy / 2
                M.Y = P.Y - leng
                M.X = P.X + leng
                N.Y = Q.Y + leng
                N.X = Q.X - leng

    return rs.AddPolyline( [M , P , Q , N] )

def taxicab_circle ( point = P3(0,0,0), r = 1 ):
    A = P3( point.X + r, point.Y, point.Z )
    B = P3( point.X, point.Y + r, point.Z )
    C = P3( point.X - r, point.Y, point.Z )
    D = P3( point.X, point.Y - r, point.Z )
    return rs.AddPolyline( [A, B, C, D, A] )

l = 2 * r

""" PL = taxicab_midnormal ( A, B, r ) """

pts = P

polylines = []
for i in range( len( P ) ):
    polylines.append(taxicab_circle( P[i], l ))

for i in range(len(polylines)):
    for j in range(i):
        if i == j:
            continue
        if rs.CurveBooleanUnion( [ polylines[i], polylines[j] ] ):
            MN = taxicab_midnormal( pts[i], pts[j], l )
            
            ccx = rs.CurveCurveIntersection( polylines[i], MN )
            if ccx is None:
                continue
            if ccx[0][0] == 2:
                continue
            para_a = [ ccx[0][5], ccx[1][5] ]
            para_b = [ ccx[0][7], ccx[1][7] ]
            
            if para_b[0] > para_b[1]:
                para_b = [ para_b[1], para_b[0] ]
            
            probable_dash = rs.SplitCurve(polylines[i], para_a)
            edge = rs.TrimCurve(MN, para_b, False )
            edgepts = rs.CurvePoints(edge)
            
            for crv in probable_dash:
                crvpts = rs.CurvePoints(crv)
                if rs.PointCompare( crvpts[0], edgepts[0] ):
                    crvpts.reverse()
                newpl = rs.AddPolyline( edgepts + crvpts )
                if rs.PointInPlanarClosedCurve( pts[i], newpl ):
                    polylines[i] = newpl
                    break
            
            
            ccx = rs.CurveCurveIntersection( polylines[j], MN )
            if ccx is None:
                continue
            para_a = [ ccx[0][5], ccx[1][5] ]
            para_b = [ ccx[0][7], ccx[1][7] ]
            
            if para_b[0] > para_b[1]:
                para_b = [ para_b[1], para_b[0] ]
            
            probable_dash = rs.SplitCurve(polylines[j], para_a)
            edge = rs.TrimCurve(MN, para_b, False )
            edgepts = rs.CurvePoints(edge)
            
            for crv in probable_dash:
                crvpts = rs.CurvePoints(crv)
                if rs.PointCompare( crvpts[0], edgepts[0] ):
                    crvpts.reverse()
                newpl = rs.AddPolyline( edgepts + crvpts )
                if rs.PointInPlanarClosedCurve( pts[j], newpl ):
                    polylines[j] = newpl
                    break
    

PL = polylines
# ---------- end ghpython_script ----------
region_intersection = RegionIntersection(CurvesA=ghpython_script.PL, CurvesB=rectangle.Rectangle)  # disabled
curve_4 = Curve(region_intersection)  # disabled
surface_2 = Surface(curve_4)  # disabled

# ----
curve_5 = Curve(voronoi)
surface_3 = Surface(curve_5)
area_2 = Area(Geometry=crv_2, UseTasks=False)  # -> Area, Centroid
sort_list = SortList(Keys=area_2.Area, ValuesValuesA=area_2.Area)  # -> Keys, ValuesValuesA
list_length_2 = ListLength(List=sort_list.ValuesValuesA)
subtraction_3 = Subtraction(A=list_length_2, B=1)
list_item_2 = ListItem(List=sort_list.ValuesValuesA, Index=subtraction_3, Wrap=True)
multiplication_3 = Multiplication(A=list_item_2, B=Slider(0.5, range=0..1))
spacepartition = CSharpScript(voronoiIn=curve_5, gridIn=crv_2, areaIn=multiplication_3, seed=number_slider_7)  # -> culledGrid, R, G, B; inputs voronoiIn: list of Polyline, gridIn: list of Polyline, areaIn: Double, seed: Int32; disabled
# ---------- spacepartition: C# usings ----------
using System.Linq;
# ---------- spacepartition: C# ----------
    var interConc = new System.Collections.Concurrent.ConcurrentBag<List<Curve>>();
    var intersections = new DataTree<Curve>();
    var repeated = new DataTree<Polyline>();
    var bools = new DataTree<bool>();
    int county = 0;
    
    for( int i = 0; i < voronoiIn.Count; ++i )
    {

      repeated.AddRange(gridIn, new GH_Path(i));
      
      System.Threading.Tasks.Parallel.For(0, gridIn.Count, j =>
      {
  
        interConc.Add(Curve.CreateBooleanIntersection(voronoiIn[i].ToNurbsCurve(), gridIn[j].ToNurbsCurve(), 1e-3).ToList());
        
        System.Threading.Interlocked.Increment(ref county);
  
      });

    }
    
    for( int i = 0; i < interConc.Count; ++i )
    {
      
      var c = interConc.ElementAt(i);
      
      for( int j = 0; j < c.Count; ++j )
    
        intersections.Add(c[j], new GH_Path(j));
    }

    R = intersections;
# ---------- end spacepartition ----------
spacepartition_2 = CSharpScript(voronoiIn=curve_5, gridIn=crv_2, areaIn=multiplication_3, seed=number_slider_7)  # -> culledGrid, R, G, B; inputs voronoiIn: list of Polyline, gridIn: list of Polyline, areaIn: Double, seed: Int32; disabled
# ---------- spacepartition_2: C# ----------
    var interConc = new System.Collections.Concurrent.ConcurrentDictionary<List<Curve>, int>();
    var intersections = new DataTree<Curve>();
    var repeated = new DataTree<Polyline>();
    var bools = new DataTree<bool>();

    for( int i = 0; i < voronoiIn.Count; ++i )
    {

      repeated.AddRange(gridIn);

      var voro = voronoiIn[i].ToNurbsCurve();
      /*
      for( int j = 0; j < gridIn.Count; ++j )
      {

        intersections.AddRange(Curve.CreateBooleanIntersection(voro, gridIn[j].ToNurbsCurve(), 1e-3).ToList(), new GH_Path(i, j));

      }
      */

      System.Threading.Tasks.Parallel.For(0, gridIn.Count, j =>
        {

        interConc.TryAdd(Curve.CreateBooleanIntersection(voro, gridIn[j].ToNurbsCurve(), 1e-3).ToList(), j);

        });



    }
    
    interConc.OrderBy(p => p.Value);
    

    int counter = 0;

    foreach( var item in interConc.Keys )
    {

      intersections.AddRange(item, new GH_Path(counter));

      counter++;

    }
  /*
    for( int i = 0; i < repeated.BranchCount; ++i )
    {

      for( int j = 0; j < interConc.Keys.Count; ++j )
      //var path = repeated.Path( i );

      intersections.AddRange( interConc.Keys.ElementAt(j), new GH_Path(i, j) );

      for( int j = 0; j < interConc.Keys.ElementAt(i).Count; ++j )

        intersections.Add(interConc.Keys.ElementAt(i)[j], new GH_Path(i, j));

    }
  */
    /*
    for( int i = 0; i < intersections.BranchCount; ++i )
    {

      var tempList = intersections.Branch(i);
      var path = new GH_Path(intersections.Path(i).Indices[0]);
      bool temp = false;

      if( tempList.Count > 0 )
      {

        var area = AreaMassProperties.Compute(intersections.Branch(i)[0]).Area;

        temp = area < areaIn ? false : true;

        bools.Add(temp, path);

      }

      else
      {

        temp = false;
        bools.Add(temp, path);

      }

    }

    var treeOut = new DataTree<Polyline>();
    var coloursOutR = new DataTree<int>();
    var coloursOutG = new DataTree<int>();
    var coloursOutB = new DataTree<int>();
    //var coloursOut = new DataTree<System.Drawing.Color>();
    var rand = new Random(seed);

    repeated.Graft();
    repeated.SimplifyPaths();

    for( int i = 0; i < bools.BranchCount; ++i )
    {

      var path = repeated.Path(i);

      coloursOutR.Add(rand.Next(0, 255), path);
      coloursOutG.Add(rand.Next(0, 255), path);
      coloursOutB.Add(rand.Next(0, 255), path);
      //coloursOut.Add( System.Drawing.Color.FromArgb( 255, rand.Next( 0, 255 ), rand.Next( 0, 255 ), rand.Next( 0, 255 ) ), path );

      //for( int j = 0; j < repeated.Branch(i).Count; ++j )
      {

        if( bools.Branch(i)[0] == true )
        {

          treeOut.Add(repeated.Branch(i)[0], path);

        }

      }

    }

    culledGrid = treeOut;
    R = coloursOutR;
    G = coloursOutG;
    B = coloursOutB;
    //R = coloursOut;*/

    culledGrid = intersections;
# ---------- end spacepartition_2 ----------
spacepartition_3 = CSharpScript(voronoiIn=curve_5, gridIn=crv_2, areaIn=multiplication_3, seed=number_slider_7)  # -> culledGrid, R, G, B; inputs voronoiIn: list of Polyline, gridIn: list of Polyline, areaIn: Double, seed: Int32; disabled
# ---------- spacepartition_3: C# ----------
    var intersections = new DataTree<Curve>();
    var repeated = new DataTree<Polyline>();
    var bools = new DataTree<bool>();

    for( int i = 0; i < voronoiIn.Count; ++i )
    {

      repeated.AddRange(gridIn, new GH_Path(i));

      var voro = voronoiIn[i].ToNurbsCurve();

      for( int j = 0; j < gridIn.Count; ++j )
      {

        intersections.AddRange(Curve.CreateBooleanIntersection(voro, gridIn[j].ToNurbsCurve(), 1e-3).ToList(), new GH_Path(j));

      }

    }

    R = intersections;
# ---------- end spacepartition_3 ----------
spacepartition_4 = CSharpScript(voronoiIn=curve_5, gridIn=crv_2, areaIn=multiplication_3, seed=number_slider_7)  # -> culledGrid, R, G, B; inputs voronoiIn: list of Polyline, gridIn: list of Polyline, areaIn: Double, seed: Int32; disabled
# ---------- spacepartition_4: C# ----------
    var intersections = new DataTree<Curve>();
    var repeated = new DataTree<Polyline>();
    var bools = new DataTree<bool>();

    for( int i = 0; i < voronoiIn.Count; ++i )
    {

      repeated.AddRange(gridIn, new GH_Path(i));

      var voro = voronoiIn[i].ToNurbsCurve();

      for( int j = 0; j < gridIn.Count; ++j )
      {

        intersections.AddRange(Curve.CreateBooleanIntersection(voro, gridIn[j].ToNurbsCurve(), 1e-3).ToList(), new GH_Path(i, j));

      }

    }

    for( int i = 0; i < intersections.BranchCount; ++i )
    {

      var tempList = intersections.Branch(i);
      var path = new GH_Path(intersections.Path(i).Indices[0]);
      bool temp = false;

      if( tempList.Count > 0 )
      {

        var area = AreaMassProperties.Compute(intersections.Branch(i)[0]).Area;

        temp = area < areaIn ? false : true;

        bools.Add(temp, path);

      }

      else
      {

        temp = false;
        bools.Add(temp, path);

      }

    }

    var treeOut = new DataTree<Polyline>();
    var coloursOutR = new DataTree<int>();
    var coloursOutG = new DataTree<int>();
    var coloursOutB = new DataTree<int>();
    //var coloursOut = new DataTree<System.Drawing.Color>();
    var rand = new Random(seed);

    for( int i = 0; i < bools.BranchCount; ++i )
    {

      var path = repeated.Path(i);

      coloursOutR.Add(rand.Next(0, 255), path);
      coloursOutG.Add(rand.Next(0, 255), path);
      coloursOutB.Add(rand.Next(0, 255), path);
      //coloursOut.Add( System.Drawing.Color.FromArgb( 255, rand.Next( 0, 255 ), rand.Next( 0, 255 ), rand.Next( 0, 255 ) ), path );

      for( int j = 0; j < bools.Branch(i).Count; ++j )
      {

        if( bools.Branch(i)[j] == true )
        {

          treeOut.Add(repeated.Branch(i)[j], path);

        }

      }

    }

    culledGrid = treeOut;
    R = intersections;
    G = coloursOutG;
    B = coloursOutB;
    //R = coloursOut;
# ---------- end spacepartition_4 ----------
spacepartition_5 = CSharpScript(voronoiIn=curve_5, gridIn=crv_2, areaIn=multiplication_3, seed=number_slider_7)  # -> culledGrid, R, G, B; inputs voronoiIn: list of Polyline, gridIn: list of Polyline, areaIn: Double, seed: Int32
# ---------- spacepartition_5: C# ----------
    var intersections = new DataTree<Curve>();
    var repeated = new DataTree<Polyline>();
    var bools = new DataTree<bool>();

    for( int i = 0; i < voronoiIn.Count; ++i )
    {

      repeated.AddRange(gridIn, new GH_Path(i));

      var voro = voronoiIn[i].ToNurbsCurve();

      for( int j = 0; j < gridIn.Count; ++j )
      {

        intersections.AddRange(Curve.CreateBooleanIntersection(voro, gridIn[j].ToNurbsCurve(), 1e-3).ToList(), new GH_Path(i, j));

      }

    }

    for( int i = 0; i < intersections.BranchCount; ++i )
    {

      var tempList = intersections.Branch(i);
      var path = new GH_Path(intersections.Path(i).Indices[0]);
      bool temp = false;

      if( tempList.Count > 0 )
      {

        var area = AreaMassProperties.Compute(intersections.Branch(i)[0]).Area;

        temp = area < areaIn ? false : true;

        bools.Add(temp, path);

      }

      else
      {

        temp = false;
        bools.Add(temp, path);

      }

    }

    var treeOut = new DataTree<Polyline>();
    var coloursOutR = new DataTree<int>();
    var coloursOutG = new DataTree<int>();
    var coloursOutB = new DataTree<int>();
    //var coloursOut = new DataTree<System.Drawing.Color>();
    var rand = new Random(seed);

    for( int i = 0; i < bools.BranchCount; ++i )
    {

      var path = repeated.Path(i);

      coloursOutR.Add(rand.Next(0, 255), path);
      coloursOutG.Add(rand.Next(0, 255), path);
      coloursOutB.Add(rand.Next(0, 255), path);
      //coloursOut.Add( System.Drawing.Color.FromArgb( 255, rand.Next( 0, 255 ), rand.Next( 0, 255 ), rand.Next( 0, 255 ) ), path );

      for( int j = 0; j < bools.Branch(i).Count; ++j )
      {

        if( bools.Branch(i)[j] == true )
        {

          treeOut.Add(repeated.Branch(i)[j], path);

        }

      }

    }

    culledGrid = treeOut;
    R = coloursOutR;
    G = coloursOutG;
    B = coloursOutB;
    //R = coloursOut;
# ---------- end spacepartition_5 ----------
panel_4 = Panel(spacepartition_2.culledGrid)  # disabled
curve_6 = Curve(flatten(spacepartition_3.R))  # disabled
curve_7 = Curve(spacepartition_2.R)  # disabled
path_mapper_5 = PathMapper(curve_6, source="{A;B}", target="{A;B}")  # disabled
panel_5 = Panel(spacepartition_4.culledGrid)  # disabled
panel_6 = Panel(curve_6)  # disabled
colour_rgb_2 = ColourRGB(Alpha=Slider(45, range=0..255), Red=spacepartition_5.R, Green=spacepartition_5.G, Blue=spacepartition_5.B)
panel_7 = Panel(spacepartition_4.R)
surface_4 = Surface(spacepartition_2.culledGrid)
curve_8 = Curve(spacepartition_5.culledGrid)
surface_5 = Surface(spacepartition_5.culledGrid)
region_union = RegionUnion(Curves=spacepartition_5.culledGrid)
colour_rgb_3 = ColourRGB(Alpha=Slider(255, range=0..255), Red=spacepartition_5.R, Green=spacepartition_5.G, Blue=spacepartition_5.B)
custom_preview = CustomPreview(Geometry=graft(surface_3), Material=colour_rgb_2)
area_3 = Area(Geometry=curve_8, UseTasks=False)  # -> Area, Centroid
fix_notsopretty = CSharpScript(CulledGrid=area_3.Centroid, OriginalGrid=area.Centroid)
panel_8 = Panel(fix_notsopretty)
region_intersection_2 = RegionIntersection(CurvesA=curve_2, CurvesB=region_union)  # -> simplify(Result)
surface_6 = Surface(region_intersection_2)
custom_preview_2 = CustomPreview(Geometry=surface_6, Material=colour_rgb_3)
flatten_tree_2 = FlattenTree(Tree=region_intersection_2, Path="{0}")
area_4 = Area(Geometry=surface_6, UseTasks=True)  # -> simplify(Area), Centroid
polytopo = CSharpScript(curveList=flatten_tree_2)  # -> relations; inputs curveList: list of Polyline
# ---------- polytopo: C# usings ----------
//using System.Linq;
# ---------- polytopo: C# ----------
    var repeat = new DataTree<Polyline>();

    var topoTree = new DataTree<int>();

    //var treeIndex = new DataTree<int>();

    int count = curveList.Count;

    for( int i = 0; i < count; ++i )
    {

      var path = new GH_Path(i);

      repeat.AddRange(curveList, path);

      var temp = repeat.Branch(i)[i];

      //treeIndex.Add(i, path);

      for( int j = 0; j < repeat.Branch(i).Count; ++j )
      {

        if( j != i )

          if( Curve.PlanarCurveCollision(temp.ToNurbsCurve(), repeat.Branch(i)[j].ToNurbsCurve(), Plane.WorldXY, 1e-3) )
          {

            topoTree.Add(j, path);

          }

      }

    }

    relations = topoTree;

    //index = treeIndex;
# ---------- end polytopo ----------
null_item = NullItem(Item=area_4.Area)  # -> NullFlags, InvalidFlags, Description
panel_9 = Panel(polytopo)
expression = Expression(x=null_item.NullFlags, y=area_4.Area, Expression="If( True, y, 1000 )")
expression_2 = Expression(x=expression, y=addition_2, z=subtraction_2, Expression="If( ( x < y) And ( x > z), 0, 1000 )")
panel_10 = Panel(null_item.NullFlags)
linetopo = CSharpScript(points=area_4.Centroid, relations=polytopo)  # -> lines; inputs points: tree of Point3d, relations: tree of Int32
# ---------- linetopo: C# ----------
    var linesOut = new DataTree<Line>();

    for( int i = 0; i < relations.BranchCount; ++i )
    {

      int count = relations.Branch(i).Count;

      for( int j = 0; j < count; ++j )
      {

        linesOut.Add(new Line(points.Branch(i)[0], points.Branch(relations.Branch(i)[j])[0]), new GH_Path(i));
        
      }

    }

    lines = linesOut;
# ---------- end linetopo ----------
mass_addition_3 = MassAddition(Input=flatten(expression_2))  # -> Result, PartialResults
graphfromnodes_links = GraphFromNodesLinks(
    Points=flatten(area_4.Centroid),
    Links=flatten(linetopo),
    Labels=flatten(addindextolabels),
    Areas=flatten(addition),
    TotalArea=mass_addition_2.Result)  # -> Graph, GraphVertices, Attributes
panel_11 = Panel(mass_addition_3.Result)
flatten_tree_3 = FlattenTree(Tree=surface_6, Path="{0}")  # disabled
explode_tree = ExplodeTree(Data=graphfromnodes_links.Attributes)
forcedirecteddrawing = ForceDirectedDrawing(
    Graph=polytopo,
    Vertices=flatten(area_4.Centroid),
    Attributes=graphfromnodes_links.Attributes,
    AttractionStrength=0.25,
    RepulsionStrength=1.4,
    ConvergenceTolearnce=0.001,
    MaximumIterations=Slider(4000, range=0..10000),
    Active=Toggle(True))  # -> NewGraphVertices, IterationCount
text_tag = TextTag(Location=area_4.Centroid, Text=addindextolabels)
list_length_3 = ListLength(List=flatten_tree_3)  # disabled
list_length_4 = ListLength(List=crv_2)  # disabled
panel_12 = Panel(list_length_3)  # disabled
panel_13 = Panel(explode_tree)
expression_3 = Expression(x=list_length_4, y=list_length_3, Expression="If( x ≠ y, False, True )")  # disabled
panel_14 = Panel(area_4.Area)
diskographdrawing = DiskoGraphDrawing(
    Plane=PlaneXY(0, 0, 0),
    Graph=polytopo,
    Vertices=forcedirecteddrawing.NewGraphVertices,
    Attributes=graphfromnodes_links.Attributes,
    Thickness=1)
panel_15 = Panel(expression_3)  # disabled
